# Grasshopper definition poc-client.gh (Grasshopper 1.0.8)
# plug-ins: RhinoCodePluginGH

script = Script(mqtt_broker="localhost", reset=Button(), on=Toggle(True))  # -> last_message
# ---------- script: Python ----------
# r: compas_eve
# venv: aec_hackathon_2025


import System
import Rhino
import Grasshopper
import rhinoscriptsyntax as rs

import functools
import time

from compas_eve import Message
from compas_eve import Topic
from compas_eve import Subscriber
from compas_eve.mqtt import MqttTransport
from compas_eve.ghpython import BackgroundWorker

def start_server(worker, mqtt_broker):
    topic_name = "ifc/IfcWall"

    def handle_message(message):
        worker.display_message("IfcWall received.".format(message))
        worker.update_result(message, 10)

    tx = MqttTransport(mqtt_broker)
    topic = Topic(topic_name)
    worker.subscriber = Subscriber(topic, callback=handle_message, transport=tx)
    worker.subscriber.subscribe()
    worker.display_message("Subscribed")

def stop_server(worker):
    if hasattr(worker, "subscriber"):
        worker.subscriber.unsubscribe()
    worker.display_message("Stopped")
    

class IfcDataBusComponent(Grasshopper.Kernel.GH_ScriptInstance):
    def RunScript(self, mqtt_broker, reset, on):
        if not on:
            BackgroundWorker.stop_instance_by_component(ghenv)  # noqa: F821
            return None

        self.worker = BackgroundWorker.instance_by_component(ghenv, start_server, dispose_function=stop_server, force_new=reset, auto_set_done=False, args=(mqtt_broker,))  # noqa: F821

        if not self.worker.is_working() and not self.worker.is_done() and reset:
            self.worker.start_work()

        print("Worker ID: {}".format(id(self.worker)))
        print("Is worker running? {}".format(self.worker.is_working()))
        print("Worker completed? {}".format(self.worker.is_done()))
        if hasattr(self.worker, "thread"):
            print("Worker thread: {}".format(self.worker.thread))

        if hasattr(self.worker, "result"):
            return self.worker.result
        else:
            return None
# ---------- end script ----------
panel = Panel(script)
